# Grasshopper definition sampleCode.gh (Grasshopper 1.0.7)
# plug-ins: topoBuilding, topoGraphy, topoROK, topoStreet, topoRiver

panel = Panel("\"C:\\Users\\BaekInchan\\Downloads\\(B010)수치지도_37709081__00000416119175\"")
toposhp = TopoSHP(SHPFolder=panel)  # -> TopoLines, TopoLinesZ, BuildingLines, BuildingLinesZ, StreetLines, WaterLines, ParkPoints, ShapefileDictionary
pt = Point(toposhp.ParkPoints)
topography = TopoGraphy(TerrainLines=toposhp.TopoLines, TerrainLinesZ=toposhp.TopoLinesZ, Resolution=Slider(12, range=0..100), Run=Toggle(True))
topobuilding = TopoBuilding(
    TopoSurface=topography,
    BuildingLines=toposhp.BuildingLines,
    BuildingLinesZ=toposhp.BuildingLinesZ,
    BuildingType="parapet",
    RemoveUnderArea=Slider(50, range=0..100),
    Run=Toggle(True))
topostreet = TopoStreet(TopoSurface=topography, StreetLines=toposhp.StreetLines, Run=Toggle(True))  # -> StreetCurve, StreetFlatCurve
topowater = TopoWater(TopoSurface=topography, WaterLine=toposhp.WaterLines, Run=Toggle(True))  # -> WaterCurve, WaterFlatCurve, WaterSurface
c_script = CSharpScript(X=topography)  # -> Out, A
