# Grasshopper definition unnamed.gh (Grasshopper 1.0.7)
# plug-ins: atit, ScriptParasite

panel = Panel(""""C:\Users\BaekInchan\Documents\카카오톡 받은 파일\(B010)수치지도_37012033_2023_00000411347321\N3P_H0059153.shp"
"C:\Users\BaekInchan\Documents\카카오톡 받은 파일\(B010)수치지도_37012033_2023_00000411347321\N3A_A0010000.shp"
"C:\Users\BaekInchan\Documents\카카오톡 받은 파일\(B010)수치지도_37012033_2023_00000411347321\N3A_A0033320.shp"
"C:\Users\BaekInchan\Documents\카카오톡 받은 파일\(B010)수치지도_37012033_2023_00000411347321\N3A_A0070000.shp"
"C:\Users\BaekInchan\Documents\카카오톡 받은 파일\(B010)수치지도_37012033_2023_00000411347321\N3A_A0110020.shp"
"C:\Users\BaekInchan\Documents\카카오톡 받은 파일\(B010)수치지도_37012033_2023_00000411347321\N3A_B0010000.shp"
"C:\Users\BaekInchan\Documents\카카오톡 받은 파일\(B010)수치지도_37012033_2023_00000411347321\N3A_C0186115.shp"
"C:\Users\BaekInchan\Documents\카카오톡 받은 파일\(B010)수치지도_37012033_2023_00000411347321\N3A_C0290000.shp"
"C:\Users\BaekInchan\Documents\카카오톡 받은 파일\(B010)수치지도_37012033_2023_00000411347321\N3A_D0010000.shp"
"C:\Users\BaekInchan\Documents\카카오톡 받은 파일\(B010)수치지도_37012033_2023_00000411347321\N3A_E0010001.shp"
"C:\Users\BaekInchan\Documents\카카오톡 받은 파일\(B010)수치지도_37012033_2023_00000411347321\N3A_E0032111.shp"
"C:\Users\BaekInchan\Documents\카카오톡 받은 파일\(B010)수치지도_37012033_2023_00000411347321\N3A_E0052114.shp"
"C:\Users\BaekInchan\Documents\카카오톡 받은 파일\(B010)수치지도_37012033_2023_00000411347321\N3A_G0010000.shp"
"C:\Users\BaekInchan\Documents\카카오톡 받은 파일\(B010)수치지도_37012033_2023_00000411347321\N3A_G0020000.shp"
"C:\Users\BaekInchan\Documents\카카오톡 받은 파일\(B010)수치지도_37012033_2023_00000411347321\N3A_H0010000.shp"
"C:\Users\BaekInchan\Documents\카카오톡 받은 파일\(B010)수치지도_37012033_2023_00000411347321\N3L_A0010000.shp"
"C:\Users\BaekInchan\Documents\카카오톡 받은 파일\(B010)수치지도_37012033_2023_00000411347321\N3L_A0020000.shp"
"C:\Users\BaekInchan\Documents\카카오톡 받은 파일\(B010)수치지도_37012033_2023_00000411347321\N3L_A0123373.shp"
"C:\Users\BaekInchan\Documents\카카오톡 받은 파일\(B010)수치지도_37012033_2023_00000411347321\N3L_B0020000.shp"
"C:\Users\BaekInchan\Documents\카카오톡 받은 파일\(B010)수치지도_37012033_2023_00000411347321\N3L_C0050000.shp"
"C:\Users\BaekInchan\Documents\카카오톡 받은 파일\(B010)수치지도_37012033_2023_00000411347321\N3L_C0060000.shp"
"C:\Users\BaekInchan\Documents\카카오톡 받은 파일\(B010)수치지도_37012033_2023_00000411347321\N3L_C0070000.shp"
"C:\Users\BaekInchan\Documents\카카오톡 받은 파일\(B010)수치지도_37012033_2023_00000411347321\N3L_E0020000.shp"
"C:\Users\BaekInchan\Documents\카카오톡 받은 파일\(B010)수치지도_37012033_2023_00000411347321\N3L_E0080000.shp"
"C:\Users\BaekInchan\Documents\카카오톡 받은 파일\(B010)수치지도_37012033_2023_00000411347321\N3L_F0010000.shp"
"C:\Users\BaekInchan\Documents\카카오톡 받은 파일\(B010)수치지도_37012033_2023_00000411347321\N3L_F0030000.shp"
"C:\Users\BaekInchan\Documents\카카오톡 받은 파일\(B010)수치지도_37012033_2023_00000411347321\N3L_F0040000.shp"
"C:\Users\BaekInchan\Documents\카카오톡 받은 파일\(B010)수치지도_37012033_2023_00000411347321\N3L_G0030000.shp"
"C:\Users\BaekInchan\Documents\카카오톡 받은 파일\(B010)수치지도_37012033_2023_00000411347321\N3P_C0285311.shp"
"C:\Users\BaekInchan\Documents\카카오톡 받은 파일\(B010)수치지도_37012033_2023_00000411347321\N3P_E0042326.shp"
"C:\Users\BaekInchan\Documents\카카오톡 받은 파일\(B010)수치지도_37012033_2023_00000411347321\N3P_F0020000.shp"
"C:\Users\BaekInchan\Documents\카카오톡 받은 파일\(B010)수치지도_37012033_2023_00000411347321\N3P_H0020000.shp"
"C:\Users\BaekInchan\Documents\카카오톡 받은 파일\(B010)수치지도_37012033_2023_00000411347321\N3P_H0040000.shp"
""")
python = GhPythonScript(x="F0010000", shapeFile=panel)  # -> out, a, ans; inputs shapeFile: list
# ---------- python: Python ----------
__author__ = "BaekInchan"
__version__ = "2024.03.23"

import rhinoscriptsyntax as rs


a = []

for i in shapeFile : 
    if(i[0] == '"') : i = i[1 :]
    if(i[-1] == '"') : i = i[:-1]
    #if(i.split("\\")[-1].split("_")[0][-1] == 'P') : continue; 
    a.append(i)

ans = ""

for i in a : 
    if x in i : 
        ans = i
        break
# ---------- end python ----------
path = FilePath(python.ans)
toggle = BooleanToggle(True)
imp_it = ImpIt(ShapefileShpPath=python.ans, Project2WGS84=False, TrueOrFalse=toggle)  # -> Shapes, Features
item = ListItem(List=imp_it.Features, Index=Slider(1, range=0..10), Wrap=True)
datavis_it = DataVisIt(Shapes=imp_it.Shapes, GetValueofFeature=item, TrueOrFalse=toggle)  # -> Polygon, Polyline, Point, AttValues
toggle_2 = BooleanToggle(True)
rider = RIder(openFile=toggle_2)  # -> Folder; inputs openFile: Boolean
# ---------- rider: C# usings ----------
using System.IO;
using System.Diagnostics;

public class ScriptUtilities
{
  public static string GetCurrentFolder(GH_Document doc)
  {
    string filePath = doc.FilePath;
    return Path.GetDirectoryName(filePath);
  }

  public static string[] GetCsFiles(string folderPath)
  {
    return Directory.GetFiles(folderPath, "*.cs");
  }

  public static void OpenFileWithRider(string filePath, Action<string> print)
  {
    try
    {
      // Define the path to the JetBrains Rider executable
      string riderPath = @"C:\Program Files\JetBrains\JetBrains Rider 2024.1.4\bin\rider64.exe";

      if (!File.Exists(riderPath))
      {
        print("Rider executable not found at: " + riderPath);
        return;
      }

      // Start the process to open the file with Rider
      ProcessStartInfo startInfo = new ProcessStartInfo
        {
          FileName = riderPath,
          Arguments = "\"" + filePath + "\"", // Enclose in quotes in case of spaces
          UseShellExecute = true
          };
      Process.Start(startInfo);
    }
    catch (Exception ex)
    {
      print("Error opening file with Rider: " + ex.Message);
    }
  }

  public static void RunScript(bool openFile, ref object Here, IGH_Component owner, Action<string> print)
  {
    // Get the current folder path
    GH_Document doc = owner.OnPingDocument();
    string currentFolder = GetCurrentFolder(doc);
    Here = currentFolder;

    // Get .cs files in the current folder
    string[] csFiles = GetCsFiles(currentFolder);
    if (csFiles.Length > 0)
    {
      string csFilePath = csFiles[0];

      if (openFile)
      {
        OpenFileWithRider(csFilePath, print);
      }
    }
    else
    {
      print("No .cs files found in the directory.");
    }
  }
}
# ---------- rider: C# ----------
   ScriptUtilities.RunScript(openFile, ref Folder, Component, Print);
# ---------- end rider ----------

c_script = CSharpScript(topoLine=datavis_it.Polyline, topoHeight=datavis_it.AttValues, offset=Slider(22, range=0..100))  # -> out, A, B, C, D; inputs topoLine: tree of Curve, topoHeight: tree of Double
# ---------- c_script: C# usings ----------
using System.IO;
using System.Linq;
# ---------- c_script: C# ----------
      List<List<Curve>> topoLineList = ConvertTreeToNestedList(topoLine);
      List<List<double>> topoHeightList = ConvertTreeToNestedList(topoHeight);
      List<List<Curve>> topoLineRet = new List<List<Curve>>();
      List<GeometryBase> gemoList = new List<GeometryBase>();
      List<Point3d> allDividePts = new List<Point3d>();

      for (int i = 0; i < topoLineList.Count; i++)
      {
        if (topoLineList[i] == null || topoHeightList[i] == null) continue; 
        Curve now = topoLineList[i][0];
        double height = topoHeightList[i][0];
        Point3d st = now.PointAtStart;
        Point3d en = MovePt(st, Vector3d.ZAxis, height);
        Curve nxt = MoveOrientPoint(now, st, en);
        topoLineRet.Add(new List<Curve>() { nxt });
        gemoList.Add(now);

        Point3d[] divLenPts;
        nxt.DivideByLength(10, false, out divLenPts); 
        if(divLenPts != null) allDividePts.AddRange(divLenPts);
      }

      Brep bbox = CalculateBoundingBox(gemoList).ToBrep();
      var segRectangle = bbox.Faces;
      var sortedRectangle = segRectangle.OrderBy(x => x.GetBoundingBox(false).Center.Z).ToList();
      var bottomCrv = Curve.JoinCurves(sortedRectangle[0].ToBrep().Edges)[0];
      var bottomCrvOffset = OffsetCurve(bottomCrv, Plane.WorldXY, 15);
      var bottomCrvOffsetPts = Discontinuity(bottomCrvOffset);


      D = allDividePts; 
      C = bottomCrvOffset;
      B = bbox;
      A = MakeDataTree2D(topoLineRet);
# ---------- c_script: C# additional code ----------
  
  
    public List<Point3d> Discontinuity(Curve x)
    {
      var seg = x.DuplicateSegments();
      List<Point3d> pts = new List<Point3d>();
      for (int i = 0; i < seg.Length; i++)
      {
        if (i == 0) pts.Add(seg[i].PointAtStart);
        pts.Add(seg[i].PointAtEnd);
      }

      if (x.IsClosed) pts.RemoveAt(pts.Count - 1);
      return pts;
    }


    public Curve OffsetCurve(Curve c, Plane p, double interval)
    {
      var seg = c.DuplicateSegments();
      var joinseg = Curve.JoinCurves(seg);
      List<Curve> outLines = new List<Curve>();
      for (int i = 0; i < joinseg.Length; i++)
      {
        outLines.AddRange(c.Offset(p, interval, 0, CurveOffsetCornerStyle.Sharp));
      }

      var ret = Curve.JoinCurves(outLines);
      return ret[0];
    }

    public static BoundingBox CalculateBoundingBox(IEnumerable < GeometryBase > geometries)
    {
      BoundingBox bbox = BoundingBox.Empty;
      foreach (var geometry in geometries)
      {
        bbox.Union(geometry.GetBoundingBox(true));
      }

      return bbox;
    }

    public Point3d MovePt(Point3d p, Vector3d v, double amp)
    {
      v.Unitize();
      Transform move = Transform.Translation(v * amp);
      p.Transform(move);
      return p;
    }

    public T MoveOrientPoint<T > (T obj, Point3d now, Point3d nxt) where T : GeometryBase
    {
      Plane baseNow = Plane.WorldXY;
      Plane st = new Plane(now, baseNow.XAxis, baseNow.YAxis);
      Plane en = new Plane(nxt, baseNow.XAxis, baseNow.YAxis);
      Transform orient = Transform.PlaneToPlane(st, en);
      obj.Transform(orient);
      return obj;
    }

    public static DataTree<T> MakeDataTree2D<T > (List < List < T >> ret)
    {
      DataTree<T> tree = new DataTree<T>();
      for (int i = 0; i < ret.Count; i++)
      {
        GH_Path path = new GH_Path(i);
        for (int j = 0; j < ret[i].Count; j++)
        {
          tree.Add(ret[i][j], path);
        }
      }

      return tree;
    }

    public List<List<T>> ConvertTreeToNestedList<T > (DataTree < T > tree)
    {
      List<List<T>> nestedList = new List<List<T>>();
      foreach (GH_Path path in tree.Paths)
      {
        List<T> subList = new List<T>(tree.Branch(path));
        nestedList.Add(subList);
      }

      return nestedList;
      ;
    }
# ---------- end c_script ----------
scriptpar = ScriptParasite(Enable=toggle_2, Folder=rider)

crv = Curve(c_script.C)
pt = Point(c_script.D)
panel_2 = Panel(datavis_it.Polyline)
